# Grasshopper definition P_One_Workshop.gh (Grasshopper 1.0.7)
# plug-ins: Robots

# ----
# Curve with smoothing
number_slider = Slider(46, range=0..100)
crv = Curve(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)
len = Length(Curve=crv)
division = Division(A=len, B=number_slider)
list = ValueList({"Bartlett-IRB120", "Bartlett-IRB1600", "Bartlett-KR6", "Bartlett-KR60", "Bartlett-KR500", "Bartlett-KR60 on track", "Bartlett-UR10", "Bartlett-KR60-FAKE", "Bartlett-TX200", "Bartlett-RX160"}, selected="Bartlett-UR10")
round = Round(Number=division)  # -> Nearest, Floor, Ceiling
number_slider_2 = Slider(5, range=0..10)
divide = DivideCurve(Curve=crv, Count=round.Floor, Kinks=False)  # -> Points, Tangents, Parameters
list_2 = ValueList({"Joint", "Linear"}, selected="Linear")
load_robot = LoadRobotSystem(Name=list, Base=PlaneXY(0, 0, 0))
pl = ConstructPlane(Origin=divide.Points, XAxis="-1,0,0", YAxis=Vector(0, 1, 0))
zone = ZoneParameter(number_slider_2)
cir = Circle(Plane=pl, Radius=number_slider_2)
target = CreateTarget(Plane=pl, Motion=list_2, Zone=zone, IsCartesian=True)
program = CreateProgram(Name="DefaultProgram", RobotSystem=load_robot, Targets1=target, StepSize=1)  # -> Program, Code, Duration, Warnings, Errors
sim = ProgramSimulation(Program=program.Program, Time=Slider(0, range=0..1), Normalized=True)  # -> SystemMeshes, JointRotations, Plane, Index, Time, Program, Errors

# ----
# Polyline with fillet
number_slider_3 = Slider(1, range=0..10)
crv_2 = Curve(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)
divide_2 = DivideCurve(Curve=crv_2, Count=number_slider_3, Kinks=Toggle(True))  # -> Points, Tangents, Parameters
list_3 = ValueList({"Bartlett-IRB120", "Bartlett-IRB1600", "Bartlett-KR6", "Bartlett-KR60", "Bartlett-KR500", "Bartlett-KR60 on track", "Bartlett-UR10", "Bartlett-KR60-FAKE", "Bartlett-TX200", "Bartlett-RX160"}, selected="Bartlett-UR10")
item = ListItem(List=divide_2.Points, Index=0, Wrap=True)
number_slider_4 = Slider(10, range=0..10)
merge = Merge(Data1=divide_2.Points, Data2=item)
list_4 = ValueList({"Joint", "Linear"}, selected="Linear")
load_robot_2 = LoadRobotSystem(Name=list_3, Base=PlaneXY(0, 0, 0))
pl_2 = ConstructPlane(Origin=merge, XAxis="-1,0,0", YAxis=Vector(0, 1, 0))
fillet = Fillet(Curve=crv_2, Radius=number_slider_4)
zone_2 = ZoneParameter(number_slider_4)
target_2 = CreateTarget(Plane=pl_2, Motion=list_4, Zone=zone_2, IsCartesian=True)
program_2 = CreateProgram(Name="DefaultProgram", RobotSystem=load_robot_2, Targets1=target_2, StepSize=1)  # -> Program, Code, Duration, Warnings, Errors
sim_2 = ProgramSimulation(Program=program_2.Program, Time=Slider(0, range=0..1), Normalized=True)  # -> SystemMeshes, JointRotations, Plane, Index, Time, Program, Errors

# ----
# Moving the robot in joint space
# Moving the robot in cartesian space
panel = Panel("0,-500,0")
list_5 = ValueList({"Bartlett-IRB120", "Bartlett-IRB1600", "Bartlett-KR6", "Bartlett-KR60", "Bartlett-UR10"}, selected="Bartlett-UR10")
axis1 = Slider(-136, range=-360..360)
axis2 = Slider(270, range=-360..360)
axis3 = Slider(-10, range=-360..360)
axis4 = Slider(150, range=-360..360)
axis5 = Slider(-52, range=-360..360)
axis6 = Slider(147, range=-360..360)
xy = XYPlane(Origin=panel)
merge_2 = Merge(Data1=axis1, Data2=axis2, Data3=axis3, Data4=axis4, Data5=axis5, Data6=axis6)
load_robot_3 = LoadRobotSystem(Name=list_5, Base=xy)
degtorad = DegreesToRadians(Degrees=merge_2, RobotSystem=load_robot_3, MechanicalGroup=0)
target_3 = CreateTarget(Joints=degtorad, IsCartesian=False)
K = Kinematics(RobotSystem=load_robot_3, Target=target_3, Geometry=True)  # -> MechanismMeshes, JointRotations, Plane, Errors
item_2 = ListItem(List=K.Plane, Index=-1, Wrap=True)
deplane = DeconstructPlane(Plane=item_2)  # -> Origin, XAxis, YAxis, ZAxis
list_6 = ValueList({"Bartlett-IRB120", "Bartlett-IRB1600", "Bartlett-KR6", "Bartlett-KR60", "Bartlett-UR10"}, selected="Bartlett-UR10")
Z = Slider(263, range=-500..500)
X = Slider(426, range=-500..500)
Y = Slider(-34, range=-500..500)
A = Slider(-43, range=-180..180)
B = Slider(97, range=-180..180)
C = Slider(14, range=-180..180)
xy_2 = XYPlane(Origin="0,500,0")
merge_3 = Merge(Data1=X, Data2=Y, Data3=Z, Data4=A, Data5=B, Data6=C)
load_robot_4 = LoadRobotSystem(Name=list_6, Base=xy_2)
list_7 = FlagFields({"Shoulder": 1, "Elbow": 2, "Wrist": 4}, selected=[])
getplane = GetPlane(Numbers=merge_3, RobotSystem=load_robot_4)
target_4 = CreateTarget(Plane=getplane, RobConf=list_7, IsCartesian=True)
K_2 = Kinematics(RobotSystem=load_robot_4, Target=target_4, Geometry=True)  # -> MechanismMeshes, JointRotations, Plane, Errors
item_3 = ListItem(List=K_2.Plane, Index=-1, Wrap=True)
deplane_2 = DeconstructPlane(Plane=item_3)  # -> Origin, XAxis, YAxis, ZAxis

zone_3 = ZoneParameter(Slider(0, range=0..100))
speed = SpeedParameter(Slider(65, range=0..100))

# ----
# Polyline
number_slider_5 = Slider(4, range=0..10)
crv_3 = Curve([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])
list_8 = ValueList({"Bartlett-IRB120", "Bartlett-IRB1600", "Bartlett-KR6", "Bartlett-KR60", "Bartlett-KR500", "Bartlett-KR60 on track", "Bartlett-UR10", "Bartlett-KR60-FAKE", "Bartlett-TX200", "Bartlett-RX160"}, selected="Bartlett-UR10")
divide_3 = DivideCurve(Curve=crv_3, Count=number_slider_5, Kinks=Toggle(True))  # -> Points, Tangents, Parameters
list_9 = ValueList({"Joint", "Linear"}, selected="Linear")
pl_3 = ConstructPlane(Origin=divide_3.Points, XAxis="-1,0,0", YAxis=Vector(0, 1, 0))
load_robot_5 = LoadRobotSystem(Name=list_8, Base=PlaneXY(0, 0, 0))
target_5 = CreateTarget(Plane=pl_3, Motion=list_9, Speed=speed, Zone=zone_3, IsCartesian=True)
program_3 = CreateProgram(Name="DefaultProgram", RobotSystem=load_robot_5, Targets1=target_5, StepSize=1)  # -> Program, Code, Duration, Warnings, Errors; disabled
sim_3 = ProgramSimulation(Program=program_3.Program, Time=Slider(0.338, range=0..1), Normalized=True)  # -> SystemMeshes, JointRotations, Plane, Index, Time, Program, Errors

viewer = ParamViewer(divide_3.Points)
speed_2 = SpeedParameter(Slider(30, range=0..100))
panel_2 = Panel(merge_2)
panel_3 = Panel(program_3.Errors)
panel_4 = Panel(program_3.Warnings)

line = LineSDL(Start=deplane.Origin, Direction=deplane.XAxis, Length=250)
line_2 = LineSDL(Start=deplane.Origin, Direction=deplane.YAxis, Length=250)
line_3 = LineSDL(Start=deplane.Origin, Direction=deplane.ZAxis, Length=250)
preview = CustomPreview(Geometry=line, Shader=ColourSwatch(SwatchColor=RGB(255, 0, 0)))
preview_2 = CustomPreview(Geometry=line_2, Shader=ColourSwatch(SwatchColor=RGB(0, 255, 0)))
preview_3 = CustomPreview(Geometry=line_3, Shader=ColourSwatch(SwatchColor=RGB(0, 0, 255)))

# ----
# Curve with tangency
number_slider_6 = Slider(25, range=0..100)
crv_4 = Curve(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)
crv_5 = Curve(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)
hframes = HorizontalFrames(Curve=crv_4, Count=number_slider_6)  # -> Frames, Parameters
pframes = PerpFrames(Curve=crv_5, Count=Slider(20, range=0..100), Align=True)  # -> Frames, Parameters
brep = Brep(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)
list_10 = ValueList({"Bartlett-IRB120", "Bartlett-IRB1600", "Bartlett-KR6", "Bartlett-KR60", "Bartlett-KR500", "Bartlett-KR60 on track", "Bartlett-UR10", "Bartlett-KR60-FAKE", "Bartlett-TX200", "Bartlett-RX160"}, selected="Bartlett-UR10")
pt = Point(Point(1.126563715, 0, 115.7089961))
deplane_3 = DeconstructPlane(Plane=pframes.Frames)  # -> Origin, XAxis, YAxis, ZAxis
deplane_4 = DeconstructPlane(Plane=hframes.Frames)  # -> Origin, XAxis, YAxis, ZAxis
mesh = MeshBrep(
    Brep=brep,
    Settings={GridMaxCount=0, GridMinCount=16, JaggedSeams=False, MaxEdgeLength=0, MinEdgeLength=0.0001, MinTolerance=0, Refine=True, RefineAngle=0, RelativeTolerance=0.65, SimplePlanes=True, Tolerance=0})
xy_3 = XYPlane(Origin=pt)
list_11 = ValueList({"Joint", "Linear"}, selected="Linear")
pl_4 = ConstructPlane(Origin=deplane_3.Origin, XAxis=expr("-X", deplane_3.XAxis), YAxis=deplane_3.YAxis)
tool = CreateTool(Name="DefaultGHTool", TCP=xy_3, Weight=0, Mesh=mesh)  # -> Tool, TCP
pl_5 = ConstructPlane(Origin=deplane_4.Origin, XAxis=expr("-x", deplane_4.XAxis), YAxis=deplane_4.YAxis)
list_12 = ValueList({"Joint", "Linear"}, selected="Linear")
list_13 = ValueList({"Bartlett-IRB120", "Bartlett-IRB1600", "Bartlett-KR6", "Bartlett-KR60", "Bartlett-KR500", "Bartlett-KR60 on track", "Bartlett-UR10", "Bartlett-KR60-FAKE", "Bartlett-TX200", "Bartlett-RX160"}, selected="Bartlett-UR10")
target_6 = CreateTarget(Plane=pl_4, Motion=list_12, IsCartesian=True)
target_7 = CreateTarget(Plane=pl_5, Motion=list_11, Tool=tool.Tool, IsCartesian=True)
load_robot_6 = LoadRobotSystem(Name=list_10, Base=PlaneXY(0, 0, 0))
load_robot_7 = LoadRobotSystem(Name=list_13, Base=PlaneXY(0, 0, 0))
program_4 = CreateProgram(Name="DefaultProgram", RobotSystem=load_robot_7, Targets1=target_7, StepSize=1)  # -> Program, Code, Duration, Warnings, Errors
program_5 = CreateProgram(Name="DefaultProgram", RobotSystem=load_robot_6, Targets1=target_6, StepSize=1)  # -> Program, Code, Duration, Warnings, Errors
sim_4 = ProgramSimulation(Program=program_4.Program, Time=Slider(0, range=0..1), Normalized=True)  # -> SystemMeshes, JointRotations, Plane, Index, Time, Program, Errors
sim_5 = ProgramSimulation(Program=program_5.Program, Time=Slider(1, range=0..1), Normalized=True)  # -> SystemMeshes, JointRotations, Plane, Index, Time, Program, Errors

# ----
# Polyline with tangency
crv_6 = Curve(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)
explode = Explode(Curve=crv_6, Recursive=True)  # -> Segments, Vertices
item_4 = ListItem(List=explode.Segments, Index="-1", Wrap=True)
cull_i = CullIndex(List=explode.Segments, Indices=["0", "-1"], Wrap=True)
item_5 = ListItem(List=explode.Segments, Index="0", Wrap=True)
panel_5 = Panel("""0
0.9""")
panel_6 = Panel("""0.1
0.9""")
panel_7 = Panel("""0.1
1""")
hframe = HorizontalFrame(Curve=reparameterize(graft(item_5)), Parameter=panel_5)  # -> flatten(Frame)
hframe_2 = HorizontalFrame(Curve=reparameterize(graft(cull_i)), Parameter=panel_6)  # -> flatten(Frame)
hframe_3 = HorizontalFrame(Curve=reparameterize(graft(item_4)), Parameter=panel_7)  # -> flatten(Frame)
merge_4 = Merge(Data1=hframe, Data2=hframe_2, Data3=hframe_3)
brep_2 = Brep(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)
pt_2 = Point(Point(1.126563715, 0, 115.7089961))
list_14 = ValueList({"Bartlett-IRB120", "Bartlett-IRB1600", "Bartlett-KR6", "Bartlett-KR60", "Bartlett-KR500", "Bartlett-KR60 on track", "Bartlett-UR10", "Bartlett-KR60-FAKE", "Bartlett-TX200", "Bartlett-RX160"}, selected="Bartlett-UR10")
deplane_5 = DeconstructPlane(Plane=merge_4)  # -> Origin, XAxis, YAxis, ZAxis
xy_4 = XYPlane(Origin=pt_2)
mesh_2 = MeshBrep(
    Brep=brep_2,
    Settings={GridMaxCount=0, GridMinCount=16, JaggedSeams=False, MaxEdgeLength=0, MinEdgeLength=0.0001, MinTolerance=0, Refine=True, RefineAngle=0, RelativeTolerance=0.65, SimplePlanes=True, Tolerance=0})
pl_6 = ConstructPlane(Origin=deplane_5.Origin, XAxis=expr("-X", deplane_5.XAxis), YAxis=deplane_5.YAxis)
tool_2 = CreateTool(Name="DefaultGHTool", TCP=xy_4, Weight=0, Mesh=mesh_2)  # -> Tool, TCP
list_15 = ValueList({"Joint", "Linear"}, selected="Linear")
load_robot_8 = LoadRobotSystem(Name=list_14, Base=PlaneXY(0, 0, 0))
target_8 = CreateTarget(Plane=pl_6, Motion=list_15, Tool=tool_2.Tool, IsCartesian=True)
program_6 = CreateProgram(Name="DefaultProgram", RobotSystem=load_robot_8, Targets1=target_8, StepSize=1)  # -> Program, Code, Duration, Warnings, Errors
sim_6 = ProgramSimulation(Program=program_6.Program, Time=Slider(0.181, range=0..1), Normalized=True)  # -> SystemMeshes, JointRotations, Plane, Index, Time, Program, Errors

# ----
# line or curve with target
number_slider_7 = Slider(30, range=0..100)
list_16 = ValueList({"Bartlett-IRB120", "Bartlett-IRB1600", "Bartlett-KR6", "Bartlett-KR60", "Bartlett-UR10"}, selected="Bartlett-UR10")
crv_7 = Curve(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)
divide_4 = DivideCurve(Curve=crv_7, Count=number_slider_7, Kinks=False)  # -> Points, Tangents, Parameters
pt_3 = Point(Point(658.3600629, 1106.341841, 154.2178653))
pt_4 = ConstructPoint(XCoordinate=0, YCoordinate=1000, ZCoordinate=0)
vec2pt = Vector2Pt(PointA=divide_4.Points, PointB=pt_3, Unitize=False)  # -> Vector, Length
xy_5 = XYPlane(Origin=pt_4)
pl_7 = PlaneNormal(Origin=divide_4.Points, ZAxis=vec2pt.Vector)
load_robot_9 = LoadRobotSystem(Name=list_16, Base=xy_5)
list_17 = ValueList({"Joint", "Linear"}, selected="Linear")
align = AlignPlanes(Planes=pl_7)
target_9 = CreateTarget(Plane=align, Motion=list_17, IsCartesian=True)
program_7 = CreateProgram(Name="DefaultProgram", RobotSystem=load_robot_9, Targets1=target_9, StepSize=1)  # -> Program, Code, Duration, Warnings, Errors
knob = ControlKnob(Decimals=2, Limit=True, Maximum=1, Minimum=0, Range=1, Value=0)
sim_7 = ProgramSimulation(Program=program_7.Program, Time=knob, Normalized=True)  # -> SystemMeshes, JointRotations, Plane, Index, Time, Program, Errors

line_4 = LineSDL(Start=deplane_2.Origin, Direction=deplane_2.XAxis, Length=250)
line_5 = LineSDL(Start=deplane_2.Origin, Direction=deplane_2.YAxis, Length=250)
line_6 = LineSDL(Start=deplane_2.Origin, Direction=deplane_2.ZAxis, Length=250)
preview_4 = CustomPreview(Geometry=line_4, Shader=ColourSwatch(SwatchColor=RGB(255, 0, 0)))
preview_5 = CustomPreview(Geometry=line_5, Shader=ColourSwatch(SwatchColor=RGB(0, 255, 0)))
preview_6 = CustomPreview(Geometry=line_6, Shader=ColourSwatch(SwatchColor=RGB(0, 0, 255)))

pt_5 = Point(Point(0, 0, 37.28464926))
number_slider_8 = Slider(6, range=0..100)

# ----
# e.g. light drawing solid lines
number_slider_9 = Slider(10, range=0..10)
crv_8 = Curve([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])
pt_6 = Point(Point(0, 0, 37.28464926))
divdist = DivideDistance(Curve=crv_8, Distance=number_slider_9)  # -> Points, Tangents, Parameters
panel_8 = Panel("""0
-1""")
xy_6 = XYPlane(Origin=pt_6)
brep_3 = Brep(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)
yz = YZPlane(Origin=divdist.Points)
tool_3 = CreateTool(Name="DefaultGHTool", TCP=xy_6, Weight=0, Mesh=brep_3)  # -> Tool, TCP
cull_i_2 = CullIndex(List=yz, Indices=panel_8, Wrap=True)
item_6 = ListItem(List=yz, Index=0, Wrap=True)  # -> Item1, Item
list_18 = ValueList({"Joint", "Linear"}, selected="Linear")
tool_4 = ToolParameter(tool_3.Tool)
speed_3 = SpeedParameter(Slider(50, range=0..100))
zone_4 = ZoneParameter(Slider(5, range=0..10))
list_19 = FlagFields({"Shoulder": 1, "Elbow": 2, "Wrist": 4}, selected="Wrist")
list_20 = ValueList({"Joint", "Linear"}, selected="Joint")
setdo = SetDO(DO="0", Value="1")
setdo_2 = SetDO(DO="0", Value="0")
target_10 = CreateTarget(
    Plane=item_6.Item,
    RobConf=list_19,
    Motion=list_20,
    Tool=tool_4,
    Speed=speed_3,
    Zone=zone_4,
    Command=setdo,
    IsCartesian=True)
target_11 = CreateTarget(Plane=cull_i_2, Motion=list_18, Tool=tool_4, Speed=speed_3, Zone=zone_4, IsCartesian=True)
target_12 = CreateTarget(Plane=item_6.Item1, Motion=list_18, Tool=tool_4, Speed=speed_3, Zone=zone_4, Command=setdo_2, IsCartesian=True)
list_21 = ValueList({"Bartlett-IRB120", "Bartlett-IRB1600", "Bartlett-KR6", "Bartlett-KR60", "Bartlett-UR10"}, selected="Bartlett-UR10")
ins = InsertItems(List=target_11, Item=target_10, Indices="0", Wrap=True)
ins_2 = InsertItems(List=ins, Item=target_12, Indices="-1", Wrap=True)  # -> flatten(List)
load_robot_10 = LoadRobotSystem(Name=list_21, Base=PlaneXY(0, 0, 0))
program_8 = CreateProgram(Name="DefaultProgram", RobotSystem=load_robot_10, Targets1=ins_2, StepSize=1)  # -> Program, Code, Duration, Warnings, Errors
knob_2 = ControlKnob(Decimals=2, Limit=True, Maximum=1, Minimum=0, Range=1, Value=0)
sim_8 = ProgramSimulation(Program=program_8.Program, Time=knob_2, Normalized=True)  # -> SystemMeshes, JointRotations, Plane, Index, Time, Program, Errors

# ----
# e.g. light drawing solid lines
crv_9 = Curve([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])
xy_7 = XYPlane(Origin=pt_5)
brep_4 = Brep(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)
divdist_2 = DivideDistance(Curve=crv_9, Distance=Slider(10, range=0..10))  # -> Points, Tangents, Parameters
tool_5 = CreateTool(Name="DefaultGHTool", TCP=xy_7, Weight=0, Mesh=brep_4)  # -> Tool, TCP
setdo_3 = SetDO(DO=number_slider_8, Value=Slider(0, range=0..1))
wait = Wait(Time=Slider(3, range=0..10))
setdo_4 = SetDO(DO=number_slider_8, Value=Slider(1, range=0..1))

# ----
# e.g. light drawing dotted line
number_slider_10 = Slider(1, range=0..1)
number_slider_11 = Slider(0, range=0..100)
crv_10 = Curve(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)
setdo_5 = SetDO(DO=number_slider_11, Value=number_slider_10)
wait_2 = Wait(Time=Slider(1, range=0..10))
setdo_6 = SetDO(DO=number_slider_11, Value=Slider(0, range=0..1))
divdist_3 = DivideDistance(Curve=crv_10, Distance=Slider(10, range=0..10))  # -> Points, Tangents, Parameters
yz_2 = YZPlane(Origin=divdist_3.Points)
groupcmd = GroupCommand(Commands=[setdo_5, wait_2, setdo_6, setdo_3, wait, setdo_4])
item_7 = ListItem(List=yz_2, Index="0", Wrap=True)
cull_i_3 = CullIndex(List=yz_2, Indices="0", Wrap=True)
list_22 = FlagFields({"Shoulder": 1, "Elbow": 2, "Wrist": 4}, selected=[])
list_23 = ValueList({"Joint", "Linear"}, selected="Linear")
list_24 = ValueList({"Joint", "Linear"}, selected="Joint")
target_13 = CreateTarget(Plane=cull_i_3, Motion=list_23, Command=groupcmd, IsCartesian=True)
target_14 = CreateTarget(Plane=item_7, RobConf=list_22, Motion=list_24, Command=groupcmd, IsCartesian=True)
list_25 = ValueList({"Bartlett-IRB120", "Bartlett-IRB1600", "Bartlett-KR6", "Bartlett-KR60", "Bartlett-UR10"}, selected="Bartlett-UR10")
merge_5 = Merge(Data1=flatten(target_14), Data2=flatten(target_13))
load_robot_11 = LoadRobotSystem(Name=list_25, Base=PlaneXY(0, 0, 0))
program_9 = CreateProgram(Name="DefaultProgram", RobotSystem=load_robot_11, Targets1=merge_5, StepSize=1)  # -> Program, Code, Duration, Warnings, Errors
knob_3 = ControlKnob(Decimals=3, Limit=True, Maximum=1, Minimum=0, Range=1, Value=0.015)
sim_9 = ProgramSimulation(Program=program_9.Program, Time=knob_3, Normalized=True)  # -> SystemMeshes, JointRotations, Plane, Index, Time, Program, Errors

yz_3 = YZPlane(Origin=divdist_2.Points)  # -> simplify(Plane)
xz = XZPlane(Origin=divdist_2.Points)
panel_9 = Panel("""0
-1""")
# pick first and the last element
item_8 = ListItem(List=xz, Index=0, Wrap=True)  # -> Item1, Item
# delete first and the last element
cull_i_4 = CullIndex(List=xz, Indices=panel_9, Wrap=True)
item_9 = ListItem(List=yz_2, Index=0, Wrap=True)
cull_i_5 = CullIndex(Wrap=True)
panel_10 = Panel(item_9)
tool_6 = ToolParameter(tool_5.Tool)
list_26 = ValueList({"Joint", "Linear"}, selected="Linear")
speed_4 = SpeedParameter(Slider(50, range=0..100))
zone_5 = ZoneParameter(Slider(5, range=0..10))
panel_11 = Panel(target_13)
target_15 = CreateTarget(Plane=cull_i_4, Motion=list_26, Tool=tool_6, Speed=speed_4, Zone=zone_5, IsCartesian=True)
list_27 = FlagFields({"Shoulder": 1, "Elbow": 2, "Wrist": 4}, selected=[])
list_28 = ValueList({"Joint", "Linear"}, selected="Joint")
setdo_7 = SetDO(DO="0", Value="0")
setdo_8 = SetDO(DO="0", Value="1")
target_16 = CreateTarget(
    Plane=item_8.Item,
    RobConf=list_27,
    Motion=list_28,
    Tool=tool_6,
    Speed=speed_4,
    Zone=zone_5,
    Command=setdo_8,
    IsCartesian=True)
target_17 = CreateTarget(Plane=item_8.Item1, Motion=list_26, Tool=tool_6, Speed=speed_4, Zone=zone_5, Command=setdo_7, IsCartesian=True)
list_29 = ValueList({"Bartlett-IRB120", "Bartlett-IRB1600", "Bartlett-KR6", "Bartlett-KR60", "Bartlett-UR10"}, selected="Bartlett-UR10")
merge_6 = Merge(Data1=simplify(target_16), Data2=simplify(target_15), Data3=simplify(target_17))  # -> flatten(Result)

resume = Button()
update = Button()
pause = Button()
remote = RemoteConnection(Program=program_9.Program, IP="192.168.0.10", Upload=update, Play=resume, Pause=pause)

panel_12 = Panel(target_16)
viewer_2 = ParamViewer(target_16)
load_robot_12 = LoadRobotSystem(Name=list_29, Base=PlaneXY(0, 0, 0))
program_10 = CreateProgram(Name="DefaultProgram", RobotSystem=load_robot_12, Targets1=merge_6, StepSize=1)  # -> Program, Code, Duration, Warnings, Errors
knob_4 = ControlKnob(Decimals=2, Limit=True, Maximum=1, Minimum=0, Range=1, Value=1)
sim_10 = ProgramSimulation(Program=program_10.Program, Time=knob_4, Normalized=True)  # -> SystemMeshes, JointRotations, Plane, Index, Time, Program, Errors

# ----
# e.g. light drawing solid line
number_slider_12 = Slider(10, range=0..10)
crv_11 = Curve(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)
pt_7 = Point(Point(0, 0, 37.28464926))
divdist_4 = DivideDistance(Curve=crv_11, Distance=number_slider_12)  # -> Points, Tangents, Parameters
xy_8 = XYPlane(Origin=pt_7)
panel_13 = Panel("""0
-1""")
brep_5 = Brep(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)
yz_4 = YZPlane(Origin=divdist_4.Points)
tool_7 = CreateTool(Name="DefaultGHTool", TCP=xy_8, Weight=0, Mesh=brep_5)  # -> Tool, TCP
cull_i_6 = CullIndex(List=yz_4, Indices=panel_13, Wrap=True)
item_10 = ListItem(List=yz_4, Index=0, Wrap=True)  # -> Item1, Item
list_30 = ValueList({"Joint", "Linear"}, selected="Linear")
tool_8 = ToolParameter(tool_7.Tool)
speed_5 = SpeedParameter(Slider(50, range=0..100))
zone_6 = ZoneParameter(Slider(5, range=0..10))
list_31 = FlagFields({"Shoulder": 1, "Elbow": 2, "Wrist": 4}, selected="Wrist")
list_32 = ValueList({"Joint", "Linear"}, selected="Joint")
setdo_9 = SetDO(DO="0", Value="1")
setdo_10 = SetDO(DO="0", Value="0")
target_18 = CreateTarget(
    Plane=item_10.Item,
    RobConf=list_31,
    Motion=list_32,
    Tool=tool_8,
    Speed=speed_5,
    Zone=zone_6,
    Command=setdo_9,
    IsCartesian=True)
target_19 = CreateTarget(Plane=cull_i_6, Motion=list_30, Tool=tool_8, Speed=speed_5, Zone=zone_6, IsCartesian=True)
target_20 = CreateTarget(Plane=item_10.Item1, Motion=list_30, Tool=tool_8, Speed=speed_5, Zone=zone_6, Command=setdo_10, IsCartesian=True)
merge_7 = Merge(Data1=flatten(target_18), Data2=flatten(target_19), Data3=flatten(target_20))
list_33 = ValueList({"Bartlett-IRB120", "Bartlett-IRB1600", "Bartlett-KR6", "Bartlett-KR60", "Bartlett-UR10"}, selected="Bartlett-UR10")
knob_5 = ControlKnob(Decimals=2, Limit=True, Maximum=1, Minimum=0, Range=1, Value=0)
load_robot_13 = LoadRobotSystem(Name=list_33, Base=PlaneXY(0, 0, 0))
program_11 = CreateProgram(Name="DefaultProgram", RobotSystem=load_robot_13, Targets1=merge_7, StepSize=1)  # -> Program, Code, Duration, Warnings, Errors
sim_11 = ProgramSimulation(Program=program_11.Program, Time=knob_5, Normalized=True)  # -> SystemMeshes, JointRotations, Plane, Index, Time, Program, Errors

# ----
# Curve
number_slider_13 = Slider(18, range=0..100)
crv_12 = Curve(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)
list_34 = ValueList({"Bartlett-IRB120", "Bartlett-IRB1600", "Bartlett-KR6", "Bartlett-KR60", "Bartlett-KR500", "Bartlett-KR60 on track", "Bartlett-UR10", "Bartlett-KR60-FAKE", "Bartlett-TX200", "Bartlett-RX160"}, selected="Bartlett-UR10")
list_35 = ValueList({"Joint", "Linear"}, selected="Linear")
load_robot_14 = LoadRobotSystem(Name=list_34, Base=PlaneXY(0, 0, 0))

flip = FlipCurve(Curve=crv_12)  # -> Curve, Flag

divide_5 = DivideCurve(Curve=flip.Curve, Count=number_slider_13, Kinks=False)  # -> Points, Tangents, Parameters
pl_8 = ConstructPlane(Origin=divide_5.Points, XAxis="-1,0,0", YAxis=Vector(0, 1, 0))
target_21 = CreateTarget(Plane=pl_8, Motion=list_35, Speed=speed_2, IsCartesian=True)
program_12 = CreateProgram(Name="DefaultProgram", RobotSystem=load_robot_14, Targets1=target_21, StepSize=1)  # -> Program, Code, Duration, Warnings, Errors
sim_12 = ProgramSimulation(Program=program_12.Program, Time=Slider(1, range=0..1), Normalized=True)  # -> SystemMeshes, JointRotations, Plane, Index, Time, Program, Errors
